# Dynamo graph Journalysis_NodeBased.dyn (Dynamo 1.3.1.1736)

file_path = Filename("..\..\..\Desktop\journals\Journals_dhess\journal.0462_SoftCrash.txt")
fromPath = FileObject(file_path)  # "File.FromPath"
# note: QUESTION:
# Does the graph execute okay? Do any nodes turn yellow?
readText = File.ReadText(fromPath)
byString = Custom[Journal.ByString](str=readText)
lines = Custom[Journal.Lines](journal=byString)

# group: Lines
rawText = Python(IN[0]=lines)  # "JournalLine.RawText"
# ---------- rawText.python (6 lines) ----------
import clr

lines = IN[0]
OUT = []
for line in lines:
	OUT.append(line.RawText)
# ----------------------------------------
type = Python(IN[0]=lines)  # "JournalLine.Type"
# ---------- type.python (6 lines) ----------
import clr

lines = IN[0]
OUT = []
for line in lines:
	OUT.append(line.Type)
# ----------------------------------------
block = Python(IN[0]=lines)  # "JournalLine.Block"
# ---------- block.python (6 lines) ----------
import clr

lines = IN[0]
OUT = []
for line in lines:
	OUT.append(line.Block)
# ----------------------------------------
number = Python(IN[0]=lines)  # "JournalLine.Number"
# ---------- number.python (6 lines) ----------
import clr

lines = IN[0]
OUT = []
for line in lines:
	OUT.append(line.Number)
# ----------------------------------------
block_2 = Python(IN[0]=lines)  # "JournalLine.Block"; same code as block

# group: Isolate any remaining commands
code_block = CodeBlock(type=type) { type == "JournalMiscCommand"; }
filterByBoolMask = List.FilterByBoolMask(list=rawText, mask=code_block)

watch = Watch(filterByBoolMask.in)

# group: Isolate any remaining comments
code_block_2 = CodeBlock(type=type) { type == "JournalComment"; }
filterByBoolMask_2 = List.FilterByBoolMask(list=rawText, mask=code_block_2)

watch_2 = Watch(filterByBoolMask_2.in)

# group: Identify remaining command types
string = StringInput(" ")
split = String.Split(filterByBoolMask.in, string)
transpose = List.Transpose(split)
firstItem = List.FirstItem(transpose)
groupByKey = List.GroupByKey(list=filterByBoolMask.in, keys=firstItem)

# note: QUESTION:
# Do you see more than three items in this list? (Dim, Set, Jrn.Size)
watch_3 = Watch(groupByKey.unique_keys)
watch_4 = Watch(groupByKey.groups)

# group: Identify remaining comment types
string_2 = StringInput(" ")
split_2 = String.Split(filterByBoolMask_2.in, string_2)
transpose_2 = List.Transpose(split_2)
firstItem_2 = List.FirstItem(transpose_2)
groupByKey_2 = List.GroupByKey(list=filterByBoolMask_2.in, keys=firstItem_2)

watch_5 = Watch(groupByKey_2.unique_keys)
# note: QUESTION:
# Would you like to be able to pull any of this data from the journal file?
watch_6 = Watch(groupByKey_2.groups)

# group: API Messages
code_block_3 = CodeBlock(type=type) { type == "JournalAPIMessage"; }
filterByBoolMask_3 = List.FilterByBoolMask(list=lines, mask=code_block_3)
messageText = Python(IN[0]=filterByBoolMask_3.in)  # "JournalAPIMessage.MessageText"
# ---------- messageText.python (9 lines) ----------
import clr

lines = IN[0]
OUT = []
for line in lines:
	if line.Type == "JournalAPIMessage":
		OUT.append(line.MessageText)
	else:
		OUT.append(None)
# ----------------------------------------
messageType = Python(IN[0]=filterByBoolMask_3.in)  # "JournalAPIMessage.MessageType"
# ---------- messageType.python (9 lines) ----------
import clr

lines = IN[0]
OUT = []
for line in lines:
	if line.Type == "JournalAPIMessage":
		OUT.append(line.MessageType)
	else:
		OUT.append(None)
# ----------------------------------------

# group: Directives
code_block_4 = CodeBlock(type=type) { type == "JournalDirective"; }
filterByBoolMask_4 = List.FilterByBoolMask(list=lines, mask=code_block_4)
values = Python(IN[0]=filterByBoolMask_4.in)  # "JournalDirective.Values"
# ---------- values.python (9 lines) ----------
import clr

lines = IN[0]
OUT = []
for line in lines:
	if line.Type == "JournalDirective":
		OUT.append(line.Values)
	else:
		OUT.append([])
# ----------------------------------------
key = Python(IN[0]=filterByBoolMask_4.in)  # "JournalDirective.Key"
# ---------- key.python (9 lines) ----------
import clr

lines = IN[0]
OUT = []
for line in lines:
	if line.Type == "JournalDirective":
		OUT.append(line.Key)
	else:
		OUT.append(None)
# ----------------------------------------

# group: Data
code_block_5 = CodeBlock(type=type) { type == "JournalData"; }
filterByBoolMask_5 = List.FilterByBoolMask(list=lines, mask=code_block_5)
values_2 = Python(IN[0]=filterByBoolMask_5.in)  # "JournalData.Values"
# ---------- values_2.python (9 lines) ----------
import clr

lines = IN[0]
OUT = []
for line in lines:
	if line.Type == "JournalData":
		OUT.append(line.Values)
	else:
		OUT.append([])
# ----------------------------------------
key_2 = Python(IN[0]=filterByBoolMask_5.in)  # "JournalData.Key"
# ---------- key_2.python (9 lines) ----------
import clr

lines = IN[0]
OUT = []
for line in lines:
	if line.Type == "JournalData":
		OUT.append(line.Key)
	else:
		OUT.append(None)
# ----------------------------------------

string_3 = StringInput("JournalData")

# group: Commands
code_block_6 = CodeBlock(type=type) { type == "JournalCommand"; }
filterByBoolMask_6 = List.FilterByBoolMask(list=lines, mask=code_block_6)
commandType = Python(IN[0]=filterByBoolMask_6.in)  # "JournalCommand.CommandType"
# ---------- commandType.python (9 lines) ----------
import clr

lines = IN[0]
OUT = []
for line in lines:
	if line.Type == "JournalCommand":
		OUT.append(line.CommandType)
	else:
		OUT.append(None)
# ----------------------------------------
commandDescription = Python(IN[0]=filterByBoolMask_6.in)  # "JournalCommand.CommandDescription"
# ---------- commandDescription.python (9 lines) ----------
import clr

lines = IN[0]
OUT = []
for line in lines:
	if line.Type == "JournalCommand":
		OUT.append(line.CommandDescription)
	else:
		OUT.append(None)
# ----------------------------------------
commandID = Python(IN[0]=filterByBoolMask_6.in)  # "JournalCommand.CommandID"
# ---------- commandID.python (9 lines) ----------
import clr

lines = IN[0]
OUT = []
for line in lines:
	if line.Type == "JournalCommand":
		OUT.append(line.CommandID)
	else:
		OUT.append(None)
# ----------------------------------------

# group: Mouse Events
code_block_7 = CodeBlock(type=type) { type == "JournalMouseEvent"; }
filterByBoolMask_7 = List.FilterByBoolMask(list=lines, mask=code_block_7)
data = Python(IN[0]=filterByBoolMask_7.in)  # "JournalMouseEvent.Data"
# ---------- data.python (9 lines) ----------
import clr

lines = IN[0]
OUT = []
for line in lines:
	if line.Type == "JournalMouseEvent":
		OUT.append(line.Data)
	else:
		OUT.append([])
# ----------------------------------------
mouseEventType = Python(IN[0]=filterByBoolMask_7.in)  # "JournalMouseEvent.MouseEventType"
# ---------- mouseEventType.python (9 lines) ----------
import clr

lines = IN[0]
OUT = []
for line in lines:
	if line.Type == "JournalMouseEvent":
		OUT.append(line.MouseEventType)
	else:
		OUT.append(None)
# ----------------------------------------

# group: GUI Resource Usage
code_block_8 = CodeBlock(type=type) { type == "JournalGUIResourceUsage"; }
filterByBoolMask_8 = List.FilterByBoolMask(list=lines, mask=code_block_8)
available = Python(IN[0]=filterByBoolMask_8.in)  # "JournalGUIResourceUsage.Available"
# ---------- available.python (9 lines) ----------
import clr

lines = IN[0]
OUT = []
for line in lines:
	if line.Type == "JournalGUIResourceUsage":
		OUT.append(line.Available)
	else:
		OUT.append(None)
# ----------------------------------------
used = Python(IN[0]=filterByBoolMask_8.in)  # "JournalGUIResourceUsage.Used"
# ---------- used.python (9 lines) ----------
import clr

lines = IN[0]
OUT = []
for line in lines:
	if line.Type == "JournalGUIResourceUsage":
		OUT.append(line.Used)
	else:
		OUT.append(None)
# ----------------------------------------
user = Python(IN[0]=filterByBoolMask_8.in)  # "JournalGUIResourceUsage.User"
# ---------- user.python (9 lines) ----------
import clr

lines = IN[0]
OUT = []
for line in lines:
	if line.Type == "JournalGUIResourceUsage":
		OUT.append(line.User)
	else:
		OUT.append(None)
# ----------------------------------------

code_block_9 = CodeBlock { 34; }

# group: UI Events
code_block_10 = CodeBlock(type=type) { type == "JournalUIEvent"; }
filterByBoolMask_9 = List.FilterByBoolMask(list=lines, mask=code_block_10)
UIEventType = Python(IN[0]=filterByBoolMask_9.in)  # "JournalUIEvent.UIEventType"
# ---------- UIEventType.python (9 lines) ----------
import clr

lines = IN[0]
OUT = []
for line in lines:
	if line.Type == "JournalUIEvent":
		OUT.append(line.UIEventType)
	else:
		OUT.append(None)
# ----------------------------------------
data_2 = Python(IN[0]=filterByBoolMask_9.in)  # "JournalUIEvent.Data"
# ---------- data_2.python (9 lines) ----------
import clr

lines = IN[0]
OUT = []
for line in lines:
	if line.Type == "JournalUIEvent":
		OUT.append(line.Data)
	else:
		OUT.append([])
# ----------------------------------------

# group: Memory Metrics
code_block_11 = CodeBlock(type=type) { type == "JournalMemoryMetrics"; }
filterByBoolMask_10 = List.FilterByBoolMask(list=lines, mask=code_block_11)
VMAvailable = Python(IN[0]=filterByBoolMask_10.in)  # "JournalMemoryMetrics.VMAvailable"
# ---------- VMAvailable.python (9 lines) ----------
import clr

lines = IN[0]
OUT = []
for line in lines:
	if line.Type == "JournalMemoryMetrics":
		OUT.append(line.VMAvailable)
	else:
		OUT.append(None)
# ----------------------------------------
VMUsed = Python(IN[0]=filterByBoolMask_10.in)  # "JournalMemoryMetrics.VMUsed"
# ---------- VMUsed.python (9 lines) ----------
import clr

lines = IN[0]
OUT = []
for line in lines:
	if line.Type == "JournalMemoryMetrics":
		OUT.append(line.VMUsed)
	else:
		OUT.append(None)
# ----------------------------------------
VMPeak = Python(IN[0]=filterByBoolMask_10.in)  # "JournalMemoryMetrics.VMPeak"
# ---------- VMPeak.python (9 lines) ----------
import clr

lines = IN[0]
OUT = []
for line in lines:
	if line.Type == "JournalMemoryMetrics":
		OUT.append(line.VMPeak)
	else:
		OUT.append(None)
# ----------------------------------------
RAMAvailable = Python(IN[0]=filterByBoolMask_10.in)  # "JournalMemoryMetrics.RAMAvailable"
# ---------- RAMAvailable.python (9 lines) ----------
import clr

lines = IN[0]
OUT = []
for line in lines:
	if line.Type == "JournalMemoryMetrics":
		OUT.append(line.RAMAvailable)
	else:
		OUT.append(None)
# ----------------------------------------
RAMUsed = Python(IN[0]=filterByBoolMask_10.in)  # "JournalMemoryMetrics.RAMUsed"
# ---------- RAMUsed.python (9 lines) ----------
import clr

lines = IN[0]
OUT = []
for line in lines:
	if line.Type == "JournalMemoryMetrics":
		OUT.append(line.RAMUsed)
	else:
		OUT.append(None)
# ----------------------------------------
RAMPeak = Python(IN[0]=filterByBoolMask_10.in)  # "JournalMemoryMetrics.RAMPeak"
# ---------- RAMPeak.python (9 lines) ----------
import clr

lines = IN[0]
OUT = []
for line in lines:
	if line.Type == "JournalMemoryMetrics":
		OUT.append(line.RAMPeak)
	else:
		OUT.append(None)
# ----------------------------------------

# group: Addin Events
code_block_12 = CodeBlock(type=type) { type == "JournalAddinEvent"; }
filterByBoolMask_11 = List.FilterByBoolMask(list=lines, mask=code_block_12)
messageText_2 = Python(IN[0]=filterByBoolMask_11.in)  # "JournalAddinEvent.MessageText"
# ---------- messageText_2.python (9 lines) ----------
import clr

lines = IN[0]
OUT = []
for line in lines:
	if line.Type == "JournalAddinEvent":
		OUT.append(line.MessageText)
	else:
		OUT.append(None)
# ----------------------------------------

# group: Keyboard Events
code_block_13 = CodeBlock(type=type) { type == "JournalKeyboardEvent"; }
filterByBoolMask_12 = List.FilterByBoolMask(list=lines, mask=code_block_13)
key_3 = Python(IN[0]=filterByBoolMask_12.in)  # "JournalKeyboardEvent.Key"
# ---------- key_3.python (9 lines) ----------
import clr

lines = IN[0]
OUT = []
for line in lines:
	if line.Type == "JournalKeyboardEvent":
		OUT.append(line.Key)
	else:
		OUT.append(None)
# ----------------------------------------

# group: TimeStamps
code_block_14 = CodeBlock(type=type) { type == "JournalTimeStamp"; }
filterByBoolMask_13 = List.FilterByBoolMask(list=lines, mask=code_block_14)
timeStampType = Python(IN[0]=filterByBoolMask_13.in)  # "JournalTimeStamp.TimeStampType"
# ---------- timeStampType.python (9 lines) ----------
import clr

lines = IN[0]
OUT = []
for line in lines:
	if line.Type == "JournalTimeStamp":
		OUT.append(line.TimeStampType)
	else:
		OUT.append(None)
# ----------------------------------------
dateTime = Python(IN[0]=filterByBoolMask_13.in)  # "JournalTimeStamp.DateTime"
# ---------- dateTime.python (9 lines) ----------
import clr

lines = IN[0]
OUT = []
for line in lines:
	if line.Type == "JournalTimeStamp":
		OUT.append(line.DateTime)
	else:
		OUT.append(None)
# ----------------------------------------
description = Python(IN[0]=filterByBoolMask_13.in)  # "JournalTimeStamp.Description"
# ---------- description.python (9 lines) ----------
import clr

lines = IN[0]
OUT = []
for line in lines:
	if line.Type == "JournalTimeStamp":
		OUT.append(line.Description)
	else:
		OUT.append(None)
# ----------------------------------------

version = Custom[Journal.Version](journal=byString)
user_2 = Custom[Journal.User](journal=byString)
loadedModels = Custom[Journal.LoadedModels](journal=byString)
lineCount = Custom[Journal.LineCount](journal=byString)
blockCount = Custom[Journal.BlockCount](journal=byString)
code_block_15 = CodeBlock {  }
code_block_16 = CodeBlock { {"JournalData","JournalDirective"}; }
getLinesByType = Custom[Journal.GetLinesByType](journal=byString, journalLineType=code_block_16)
code_block_17 = CodeBlock { 30..34; }
getLinesByBlock = Custom[Journal.GetLinesByBlock](journal=byString, journalBlock=code_block_17)
