# Dynamo graph GenerateNodeDocumentationMarkdownFiles.dyn (Dynamo 2.16.1.2727)
# packages: Clockwork for Dynamo 2.x 2.4.0

# group: Generate Node Documentation Markdown Files
# note: This graph generates a markdown node documentation file for the doc folder.

# group: INPUTS
node_directory_path = Directory("C:\Users\adsk\Documents\andreas\repos\Journalysis\nodes\2.x")  # graph input
doc_directory_path = Directory("C:\Users\adsk\Documents\andreas\repos\Journalysis\doc")
text_template = StringInput("""{1}## Sample file
- Download sample file: [All{0}Nodes.dyn](https://raw.githubusercontent.com/andydandy74/Journalysis/master/samples/2.x/All{0}Nodes.dyn)
- [More sample files](https://github.com/andydandy74/Journalysis/tree/master/samples/2.x)

## Useful links
- [Journalysis repository on GitHub](https://github.com/andydandy74/Journalysis)
- [Report an issue](https://github.com/andydandy74/Journalysis/issues)
- [Version history](https://github.com/andydandy74/Journalysis/wiki/Version-history)
- [Journalysis wiki](https://github.com/andydandy74/Journalysis/wiki)

![Journalysis logo](https://raw.githubusercontent.com/andydandy74/Journalysis/master/icons/raw/Journalysis.png)""")
regex_for_sample_files = StringInput("\.(Journal|WorksharingLog|KeyboardShortcuts)\.")
journal_line_types = StringInput("""JournalAddinEvent
JournalAPIMessage
JournalBasicFileInfo
JournalCommand
JournalData
JournalDirective
JournalGUIResourceUsage
JournalKeyboardEvent
JournalMemoryMetrics
JournalMouseEvent
JournalSystemInformation
JournalTimeStamp
JournalUIEvent
JournalWorksharingEvent""")
background_info_journal_line = StringInput("""## Background information
[Learn more about the {0} line type](https://github.com/andydandy74/Journalysis/wiki/JournalLine-types#{1})

""")  # "Background info journal line tyoes"

# group: Get node names from directory
fromPath = DirectoryObject(path=node_directory_path)  # "Directory.FromPath"
string = StringInput("*.dyf")  # graph input
getDirectoryContents = FileSystem.GetDirectoryContents(directory=fromPath, searchString=string)

# group: Create background info section for journal line types
string_2 = StringInput("\n")
split = String.Split(string=journal_line_types, separator0=string_2)
boolean = BoolSelector(false)
fileName = FileSystem.FileName(path=getDirectoryContents.files, withExtension=boolean)
string_3 = StringInput(".")
split_2 = String.Split(string=fileName, separator0=string_3)
firstItem = List.FirstItem(list=split_2@L2)
contains = List.Contains(list=split, item=firstItem@L1)
toLower = String.ToLower(string=firstItem)
list_create = List.Create(item0=firstItem, item1=toLower)
transpose = List.Transpose(lists=list_create)
replace = Custom[String.Replace+](str=background_info_journal_line, replacements=transpose@L2)  # package Clockwork for Dynamo 2.x; Replaces multiple items in a given string. Items in the string have to be denoted as {0], {1}, ..., {n} - corresponding to the respective list index of the replacement string.
code_block = CodeBlock(isLineType=contains, bkgInfo=replace) { isLineType ? bkgInfo : ""; }

# group: Generate node docs
properties = Custom[CustomNode.Properties](path=getDirectoryContents.files)  # package Clockwork for Dynamo 2.x; Extracts information from a custom node.
code_block_2 = CodeBlock(p1=properties.Category, p2=properties.Name, path=doc_directory_path)
# ---------- code_block_2.designscript (4 lines) ----------
//  doc code
docCode = p1 + "." + p2;
// filename
path + "\\" + docCode + ".md";
# ----------------------------------------
findRegularExpression = Custom[Regex.FindRegularExpression](RegEx=regex_for_sample_files, str=code_block_2.docCode)  # package Clockwork for Dynamo 2.x; Returns all occurences of a regular expression within a string (or list of strings). The syntax for regular expressions is explained at http://ironpython-test.readthedocs.org/en/latest/howto/regex.html
firstItem_2 = List.FirstItem(list=findRegularExpression@L2)
list_create_2 = List.Create(item0=firstItem_2, item1=code_block)
transpose_2 = List.Transpose(lists=list_create_2)
replace_2 = Custom[String.Replace+](str=text_template, replacements=transpose_2@L2)
writeText = FileSystem.WriteText(filePath=code_block_2.out1, text=replace_2)
