# Dynamo custom node Helpers.AllJournalAPIMessageTypes.dyf (Dynamo 2.0.3.8810)
# category: Journalysis.Journal.Helpers.Query
# Lists all JournalAPIMessage types

string = StringInput("""AddedPushbutton
Exception
RegisteredExternalServer
RegisteredExternalService
RegisteringCommandEvent
RegisteringEvent
ReplacingCommandID
RestoringCommandID
StartingExternalApp
StartingExternalDBApp
Unknown
UnregisteringEvent""")  # graph input
string_2 = StringInput("\n")  # graph input
split = String.Split(str=string, separater0=string_2)
seq = Output(split)
