# Dynamo custom node Journal.LineCount.dyf (Dynamo 2.16.2.5624)
# category: Journalysis.Query
# Returns the number of lines in a given journal

journal = Input(journal: var[]..[])
python_script = Python(IN[0]=journal)  # CPython3
# ---------- python_script.python (11 lines) ----------
import clr

def process_input(func, input):
	if isinstance(input, list): return [func(x) for x in input]
	else: return func(input)
	
def journalLineCount(journal):
	if journal.__repr__() == 'Journal': return journal.LineCount
	else: return 0

OUT = process_input(journalLineCount,IN[0])
# ----------------------------------------
int = Output(python_script)
