# Dynamo custom node Journal.MinRAMAvailable.dyf (Dynamo 2.12.1.8246)
# category: Journalysis.Actions
# Computes the minimum RAM available during a Revit session based on the given journal

journal = Input(journal: var[]..[])
python_script = Python(IN[0]=journal)  # CPython3
# ---------- python_script.python (11 lines) ----------
import clr

def process_input(func, input):
	if isinstance(input, list): return [func(x) for x in input]
	else: return func(input)
	
def journalMinRAMAvailable(journal):
	if journal.__repr__() == 'Journal': return journal.GetMinRAMAvailable()
	else: return None

OUT = process_input(journalMinRAMAvailable,IN[0])
# ----------------------------------------
int = Output(python_script)
