# Dynamo custom node Journal.ProcessingTime.dyf (Dynamo 2.16.2.5624)
# category: Journalysis.Query
# Returns the time it took the Journal.ByString node to process a given journal

journal = Input(journal: var[]..[])
python_script = Python(IN[0]=journal)  # CPython3
# ---------- python_script.python (11 lines) ----------
import clr

def process_input(func, input):
	if isinstance(input, list): return [func(x) for x in input]
	else: return func(input)
	
def journalProcessingTime(journal):
	if journal.__repr__() == 'Journal': return journal.ProcessingTime
	else: return None

OUT = process_input(journalProcessingTime,IN[0])
# ----------------------------------------
create = TimeSpan.Create(seconds=python_script)
timeSpan = Output(create)
