# Dynamo custom node Journal.RevitBranch.dyf (Dynamo 2.16.2.5624)
# category: Journalysis.Query
# Returns the Revit branch from a given journal

journal = Input(journal: var[]..[])
python_script = Python(IN[0]=journal)  # CPython3
# ---------- python_script.python (11 lines) ----------
import clr

def process_input(func, input):
	if isinstance(input, list): return [func(x) for x in input]
	else: return func(input)
	
def journalBranch(journal):
	if journal.__repr__() == 'Journal': return journal.Branch
	else: return None

OUT = process_input(journalBranch,IN[0])
# ----------------------------------------
str = Output(python_script)
