# Dynamo custom node JournalAPIMessage.IsError.dyf (Dynamo 2.12.1.8246)
# category: Journalysis.Journal.JournalLine.Query
# Returns whether an APIMessage reports an error

journalAPIMessage = Input(journalAPIMessage: var[]..[])
python_script = Python(IN[0]=journalAPIMessage)  # CPython3
# ---------- python_script.python (11 lines) ----------
import clr

def process_input(func, input):
	if isinstance(input, list): return [func(x) for x in input]
	else: return func(input)
	
def journalAPIMessageIsError(japimsg):
	if japimsg.__repr__() == 'JournalAPIMessage': return japimsg.IsError
	else: return None

OUT = process_input(journalAPIMessageIsError,IN[0])
# ----------------------------------------
bool = Output(python_script)
