# Dynamo custom node JournalAPIMessage.Text.dyf (Dynamo 2.12.1.8246)
# category: Journalysis.Journal.JournalLine.Query
# Returns the text from an APIMessage line

journalAPIMessage = Input(journalAPIMessage: var[]..[])
python_script = Python(IN[0]=journalAPIMessage)  # CPython3
# ---------- python_script.python (11 lines) ----------
import clr

def process_input(func, input):
	if isinstance(input, list): return [func(x) for x in input]
	else: return func(input)
	
def journalAPIMessageText(japimsg):
	if japimsg.__repr__() == 'JournalAPIMessage': return japimsg.MessageText
	else: return None

OUT = process_input(journalAPIMessageText,IN[0])
# ----------------------------------------
str = Output(python_script)
