# Dynamo custom node JournalBasicFileInfo.Worksharing.dyf (Dynamo 2.12.1.8246)
# category: Journalysis.Journal.JournalLine.Query
# Returns the worksharing status from a BasicFileInfo line

journalBasicFileInfo = Input(journalBasicFileInfo: var[]..[])
python_script = Python(IN[0]=journalBasicFileInfo)  # CPython3
# ---------- python_script.python (11 lines) ----------
import clr

def process_input(func, input):
	if isinstance(input, list): return [func(x) for x in input]
	else: return func(input)
	
def journalBFIWorksharing(jbfi):
	if jbfi.__repr__() == 'JournalBasicFileInfo': return jbfi.Worksharing
	else: return None

OUT = process_input(journalBFIWorksharing,IN[0])
# ----------------------------------------
str = Output(python_script)
