# Dynamo custom node JournalCommand.Description.dyf (Dynamo 2.12.1.8246)
# category: Journalysis.Journal.JournalLine.Query
# Returns the description of a JournalCommand line

journalCommand = Input(journalCommand: var[]..[])
python_script = Python(IN[0]=journalCommand)  # CPython3
# ---------- python_script.python (11 lines) ----------
import clr

def process_input(func, input):
	if isinstance(input, list): return [func(x) for x in input]
	else: return func(input)
	
def journalCommandDescription(jcommand):
	if jcommand.__repr__() == 'JournalCommand': return jcommand.CommandDescription
	else: return None

OUT = process_input(journalCommandDescription,IN[0])
# ----------------------------------------
str = Output(python_script)
