# Dynamo custom node JournalDirective.Values.dyf (Dynamo 2.12.1.8246)
# category: Journalysis.Journal.JournalLine.Query
# Returns the values from a JournalDirective line

journalDirective = Input(journalDirective: var[]..[])
python_script = Python(IN[0]=journalDirective)  # CPython3
# ---------- python_script.python (11 lines) ----------
import clr

def process_input(func, input):
	if isinstance(input, list): return [func(x) for x in input]
	else: return func(input)
	
def journalDirectiveValues(jdirective):
	if jdirective.__repr__() == 'JournalDirective': return jdirective.Values
	else: return []

OUT = process_input(journalDirectiveValues,IN[0])
# ----------------------------------------
seq = Output(python_script)
