# Dynamo custom node JournalLine.AllNext.dyf (Dynamo 2.12.1.8246)
# category: Journalysis.Journal.Actions
# Retrieves all lines after the given line from the journal

journalLine = Input(journalLine: var[]..[])
python_script = Python(IN[0]=journalLine)  # CPython3
# ---------- python_script.python (12 lines) ----------
import clr

def process_input(func, input):
	if isinstance(input, list): return [func(x) for x in input]
	else: return func(input)
	
def journalLineAllNext(jline):
	if hasattr(jline, 'AllNext'): 
		return jline.AllNext()
	else: return None

OUT = process_input(journalLineAllNext, IN[0])
# ----------------------------------------
journalLines = Output(python_script)
