# Dynamo custom node JournalLine.Block.dyf (Dynamo 2.12.1.8246)
# category: Journalysis.Journal.Query
# Returns the block number of a given journal line

journalLine = Input(journalLine: var[]..[])
python_script = Python(IN[0]=journalLine)  # CPython3
# ---------- python_script.python (11 lines) ----------
import clr

def process_input(func, input):
	if isinstance(input, list): return [func(x) for x in input]
	else: return func(input)
	
def journalLineBlock(jline):
	if hasattr(jline, 'Block'): return jline.Block
	else: return None

OUT = process_input(journalLineBlock,IN[0])
# ----------------------------------------
int = Output(python_script)
