# Dynamo custom node JournalMouseEvent.Data.dyf (Dynamo 2.12.1.8246)
# category: Journalysis.Journal.JournalLine.Query
# Returns the data from a MouseEvent line

journalMouseEvent = Input(journalMouseEvent: var[]..[])
python_script = Python(IN[0]=journalMouseEvent)  # CPython3
# ---------- python_script.python (11 lines) ----------
import clr

def process_input(func, input):
	if isinstance(input, list): return [func(x) for x in input]
	else: return func(input)
	
def journalMouseEventData(input):
	if input.__repr__() == 'JournalMouseEvent': return input.Data
	else: return []

OUT = process_input(journalMouseEventData,IN[0])
# ----------------------------------------
seq = Output(python_script)
