# Dynamo custom node LoadedLink.LoadEnd.dyf (Dynamo 2.12.1.8246)
# category: Journalysis.WorksharingLog.WorksharingSession.Query
# Returns the date and time a given loaded link completed loading

loadedLink = Input(loadedLink: var[]..[])
python_script = Python(IN[0]=loadedLink)  # CPython3
# ---------- python_script.python (11 lines) ----------
import clr

def process_input(func, input):
	if isinstance(input, list): return [func(x) for x in input]
	else: return func(input)
	
def LoadedLinkEnd(link):
	if link.__repr__() == 'LoadedLink': return link.LoadEnd
	else: return None

OUT = process_input(LoadedLinkEnd,IN[0])
# ----------------------------------------
dateTime = Output(python_script)
