# Dynamo custom node LoadedModel.Version.dyf (Dynamo 2.12.1.8246)
# category: Journalysis.Journal.Actions
# Retrieves the version of a loaded model

loadedModel = Input(loadedModel: var[]..[])
python_script = Python(IN[0]=loadedModel)  # CPython3
# ---------- python_script.python (11 lines) ----------
import clr

def process_input(func, input):
	if isinstance(input, list): return [func(x) for x in input]
	else: return func(input)
	
def LMVersion(model):
	if model.__repr__() == 'LoadedModel': return model.GetVersion()
	else: return None

OUT = process_input(LMVersion,IN[0])
# ----------------------------------------
str = Output(python_script)
