# Dynamo custom node Paths.AllKeyboardShortcutFiles.dyf (Dynamo 2.12.1.8246)
# category: Journalysis.KeyboardShortcuts.Query
# Retrieves a list of all keyboard shortcuts files on the current machine

python_script = Python()  # CPython3; graph input
# ---------- python_script.python (3 lines) ----------
import clr
from System import Environment
OUT = Environment.GetFolderPath(Environment.SpecialFolder.ApplicationData)
# ----------------------------------------
string = StringInput("Autodesk\Revit")  # graph input
combinePath = FileSystem.CombinePath(string0=python_script, string1=string)
fromPath = DirectoryObject(path=combinePath)  # "Directory.FromPath"
getDirectoryContents = FileSystem.GetDirectoryContents(directory=fromPath)
fileName = FileSystem.FileName(path=getDirectoryContents.directories)
string_2 = StringInput("Autodesk Revit")  # graph input
startsWith = String.StartsWith(string=fileName, searchFor=string_2)
filterByBoolMask = List.FilterByBoolMask(list=getDirectoryContents.directories, mask=startsWith)
code_block = CodeBlock(dir=filterByBoolMask.in) { dir + "\\KeyboardShortcuts.xml"; }
fileExists = FileSystem.FileExists(path=code_block)
filterByBoolMask_2 = List.FilterByBoolMask(list=code_block, mask=fileExists)
seq = Output(filterByBoolMask_2.in)
