# Dynamo custom node SyncEvent.Duration.dyf (Dynamo 2.12.1.8246)
# category: Journalysis.WorksharingLog.WorksharingSession.Query
# Returns the duration of a given SyncEvent

syncEvent = Input(syncEvent: var[]..[])
python_script = Python(IN[0]=syncEvent)  # CPython3
# ---------- python_script.python (11 lines) ----------
import clr

def process_input(func, input):
	if isinstance(input, list): return [func(x) for x in input]
	else: return func(input)
	
def SyncEventDuration(syncevent):
	if syncevent.__repr__() == 'SyncEvent': return syncevent.Duration
	else: return None

OUT = process_input(SyncEventDuration,IN[0])
# ----------------------------------------
timeSpan = Output(python_script)
