# Dynamo custom node SyncEvent.Start.dyf (Dynamo 2.12.1.8246)
# category: Journalysis.WorksharingLog.WorksharingSession.Query
# Returns the date and time a given SyncEvent started

syncEvent = Input(syncEvent: var[]..[])
python_script = Python(IN[0]=syncEvent)  # CPython3
# ---------- python_script.python (11 lines) ----------
import clr

def process_input(func, input):
	if isinstance(input, list): return [func(x) for x in input]
	else: return func(input)
	
def SyncEventStart(syncevent):
	if syncevent.__repr__() == 'SyncEvent': return syncevent.Start
	else: return None

OUT = process_input(SyncEventStart,IN[0])
# ----------------------------------------
dateTime = Output(python_script)
