# Dynamo custom node WorksharingLog.Version.dyf (Dynamo 2.12.1.8246)
# category: Journalysis.Query
# Returns the version of a given WorksharingLog

worksharingLog = Input(worksharingLog: var[]..[])
python_script = Python(IN[0]=worksharingLog)  # CPython3
# ---------- python_script.python (11 lines) ----------
import clr

def process_input(func, input):
	if isinstance(input, list): return [func(x) for x in input]
	else: return func(input)
	
def WSLogVersion(wslog):
	if wslog.__repr__() == 'WorksharingLog': return wslog.Version
	else: return None

OUT = process_input(WSLogVersion,IN[0])
# ----------------------------------------
str = Output(python_script)
