# Dynamo custom node WorksharingSession.Central.dyf (Dynamo 2.12.1.8246)
# category: Journalysis.WorksharingLog.Query
# Returns the file path to the central model of a given WorksharingSession

worksharingSession = Input(worksharingSession: var[]..[])
python_script = Python(IN[0]=worksharingSession)  # CPython3
# ---------- python_script.python (11 lines) ----------
import clr

def process_input(func, input):
	if isinstance(input, list): return [func(x) for x in input]
	else: return func(input)
	
def WSSessionCentral(wssess):
	if wssess.__repr__() == 'WorksharingSession': return wssess.Central
	else: return None

OUT = process_input(WSSessionCentral,IN[0])
# ----------------------------------------
str = Output(python_script)
