# Dynamo custom node WorksharingSession.End.dyf (Dynamo 2.12.1.8246)
# category: Journalysis.WorksharingLog.Query
# Returns the date and time a given WorksharingSession was concluded

worksharingSession = Input(worksharingSession: var[]..[])
python_script = Python(IN[0]=worksharingSession)  # CPython3
# ---------- python_script.python (11 lines) ----------
import clr

def process_input(func, input):
	if isinstance(input, list): return [func(x) for x in input]
	else: return func(input)
	
def WSSessionEnd(wssess):
	if wssess.__repr__() == 'WorksharingSession': return wssess.End
	else: return None

OUT = process_input(WSSessionEnd,IN[0])
# ----------------------------------------
dateTime = Output(python_script)
