# Dynamo custom node WorksharingSession.LoadDuration.dyf (Dynamo 2.12.1.8246)
# category: Journalysis.WorksharingLog.Actions
# Computes the load time of the model (not including loading of linked models) for a given WorksharingSession

worksharingSession = Input(worksharingSession: var[]..[])
python_script = Python(IN[0]=worksharingSession)  # CPython3
# ---------- python_script.python (11 lines) ----------
import clr

def process_input(func, input):
	if isinstance(input, list): return [func(x) for x in input]
	else: return func(input)
	
def WSSessionLoadDuration(wssess):
	if wssess.__repr__() == 'WorksharingSession': return wssess.GetLoadDuration()
	else: return None

OUT = process_input(WSSessionLoadDuration,IN[0])
# ----------------------------------------
timeSpan = Output(python_script)
