# Dynamo custom node WorksharingSession.Type.dyf (Dynamo 2.12.1.8246)
# category: Journalysis.WorksharingLog.Actions
# Returns the type of a given WorksharingSession

worksharingSession = Input(worksharingSession: var[]..[])
python_script = Python(IN[0]=worksharingSession)  # CPython3
# ---------- python_script.python (11 lines) ----------
import clr

def process_input(func, input):
	if isinstance(input, list): return [func(x) for x in input]
	else: return func(input)
	
def WSSessionType(wssess):
	if wssess.__repr__() == 'WorksharingSession': return wssess.GetSessionType()
	else: return None

OUT = process_input(WSSessionType,IN[0])
# ----------------------------------------
str = Output(python_script)
