# Dynamo custom node WorksharingSession.User.dyf (Dynamo 2.12.1.8246)
# category: Journalysis.WorksharingLog.Query
# Returns the Revit user name of a given WorksharingSession

worksharingSession = Input(worksharingSession: var[]..[])
python_script = Python(IN[0]=worksharingSession)  # CPython3
# ---------- python_script.python (11 lines) ----------
import clr

def process_input(func, input):
	if isinstance(input, list): return [func(x) for x in input]
	else: return func(input)
	
def WSSessionUser(wssess):
	if wssess.__repr__() == 'WorksharingSession': return wssess.User
	else: return None

OUT = process_input(WSSessionUser,IN[0])
# ----------------------------------------
str = Output(python_script)
