# Dynamo custom node WorksharingSession.WasTerminatedProperly.dyf (Dynamo 2.12.1.8246)
# category: Journalysis.WorksharingLog.Actions
# Determines whether a given WorksharingSession was terminated properly

worksharingSession = Input(worksharingSession: var[]..[])
python_script = Python(IN[0]=worksharingSession)  # CPython3
# ---------- python_script.python (11 lines) ----------
import clr

def process_input(func, input):
	if isinstance(input, list): return [func(x) for x in input]
	else: return func(input)
	
def WSSessionWasTerminatedProperly(wssess):
	if wssess.__repr__() == 'WorksharingSession': return wssess.WasTerminatedProperly()
	else: return None

OUT = process_input(WSSessionWasTerminatedProperly,IN[0])
# ----------------------------------------
bool = Output(python_script)
