# Dynamo custom node Helpers.AllJournalAPIMessageTypes.dyf (Dynamo 1.3.1.1736)
# category: Journalysis.Helpers.Query

string = StringInput("""Error
Success""")
string_2 = StringInput("\n")
split = String.Split(string, string_2)
seq = Output(split)
