# Dynamo custom node Journal.BlockCount.dyf (Dynamo 1.3.1.1736)
# category: Journalysis.Journal.Query

journal = Input()
python_script = Python(IN[0]=journal)
# ---------- python_script.python (11 lines) ----------
import clr

def process_input(func, input):
	if isinstance(input, list): return [func(x) for x in input]
	else: return func(input)
	
def journalBlockCount(journal):
	if journal.__repr__() == 'Journal': return journal.BlockCount
	else: return 0

OUT = process_input(journalBlockCount,IN[0])
# ----------------------------------------
blockCount = Output(python_script)
