# Dynamo custom node Journal.LoadedAssemblies.dyf (Dynamo 1.3.1.1736)
# category: Journalysis.Journal.Actions
# Pulls a list of all loaded assemblies (i.e. addin DLLs) from a given journal

journal = Input()
python_script = Python(IN[0]=journal)
# ---------- python_script.python (45 lines) ----------
import clr

class LoadedAssembly:
	def __init__(self, name, classname, path, vendor, initialEvent):
		self.Name = name
		self.Class = classname
		self.Path = path
		self.Filename = path.split("\\")[-1]
		self.Vendor = vendor
		self.GUID = None
		self.Events = [initialEvent]
	def __repr__(self):
		return "LoadedAssembly"

journal = IN[0]
loadedAssemblies = []
OUT = []
apimsgs = journal.GetLinesByType("JournalAPIMessage")

for apimsg in apimsgs:
	if apimsg.MessageText.startswith("Starting"):
		startdata1 = apimsg.MessageText.split("Application: ")[-1].split(", Class: ")
		startdata2 = startdata1[-1].split(", Vendor : ")
		startdata3 = startdata2[-1].split(", Assembly: ") 
		appname = startdata1[0]
		classname = startdata2[0]
		path = startdata3[-1]
		vendor = startdata3[0]
		loadedAssemblies.append(LoadedAssembly(appname, classname, path, vendor, apimsg))
		
for apimsg in apimsgs:
	if apimsg.MessageText.startswith("Registering") or apimsg.MessageText.startswith("Unregistering") or apimsg.MessageText.startswith("API registering") or apimsg.MessageText.startswith("API unregistering"):
		regevt1 = apimsg.MessageText.split("by application ")[-1].rsplit(" (",1)
		appname = regevt1[0]
		appguid = regevt1[1][:-2]
		foundByGUID = [x for x in loadedAssemblies if x.GUID == appguid]
		if len(foundByGUID) > 0:
			foundByGUID[0].Events.append(apimsg)
		else:
			foundByName = [x for x in loadedAssemblies if x.Name == appname and x.GUID == None]
			if len(foundByName) > 0:
				foundByName[0].GUID = appguid
				foundByName[0].Events.append(apimsg)
				
OUT = loadedAssemblies
# ----------------------------------------
seq = Output(python_script)
