# Dynamo custom node Journal.StripComments.dyf (Dynamo 1.3.1.1736)
# category: Journalysis.Journal.Actions
# Strips all comments from the original journal string and only returns all (re-formatted) lines that are potentially relevant for journal playback.

journal = Input()
python_script = Python(IN[0]=journal)
# ---------- python_script.python (13 lines) ----------
import clr

def process_input(func, input):
	if isinstance(input, list): return [func(x) for x in input]
	else: return func(input)
	
def journalStripComments(journal):
	if journal.__repr__() == 'Journal': return journal.StripComments()
	else: return None

OUT = process_input(journalStripComments,IN[0])

OUT = journal.StripComments()
# ----------------------------------------
str = Output(python_script)
