# Dynamo custom node JournalLine.Next.dyf (Dynamo 1.3.1.1736)
# category: Journalysis.JournalLine.JournalLine.Actions
# Retrieves the next line after the given line

journalLine = Input()
python_script = Python(IN[0]=journalLine)
# ---------- python_script.python (12 lines) ----------
import clr

def process_input(func, input):
	if isinstance(input, list): return [func(x) for x in input]
	else: return func(input)
	
def journalLineNext(jline):
	if hasattr(jline, 'Next'): 
		return jline.Next()
	else: return None

OUT = process_input(journalLineNext, IN[0])
# ----------------------------------------
journalLine_2 = Output(python_script)  # "journalLine"
