# Dynamo custom node JournalLine.RawText.dyf (Dynamo 1.3.1.1736)
# category: Journalysis.JournalLine.Query

journalLine = Input()
python_script = Python(IN[0]=journalLine)
# ---------- python_script.python (11 lines) ----------
import clr

def process_input(func, input):
	if isinstance(input, list): return [func(x) for x in input]
	else: return func(input)
	
def journalLineRawText(input):
	if hasattr(input, 'RawText'): return input.RawText
	else: return None

OUT = process_input(journalLineRawText,IN[0])
# ----------------------------------------
rawText = Output(python_script)
