# Dynamo custom node Paths.KeyboardShortcutsFileByVersion.dyf (Dynamo 1.3.1.1736)
# category: Journalysis.Paths.Actions
# Retrieves the path of the keyboard shortcuts file for a given Revit version.

allKeyboardShortcutFiles = Custom[Paths.AllKeyboardShortcutFiles]()  # Retrieves a list of all journal folders on the current machine
revitVersion = Input(revitVersion : string)
contains = String.Contains(str=allKeyboardShortcutFiles, searchFor=revitVersion)
filterByBoolMask = List.FilterByBoolMask(list=allKeyboardShortcutFiles, mask=contains)
firstItem = List.FirstItem(filterByBoolMask.in)
path = Output(firstItem)
