# Dynamo graph Journals_HealthCheck.dyn (Dynamo 2.0.3.8810)

# group: Inputs
directory_path_target = Directory("C:\temp")  # graph input
filename_sheetname = StringInput("JournalHealthCheck")  # graph input
directory_path_source = Directory("U:\Journals\Journals")  # graph input

# group: Read source directory
directory_from_path = DirectoryObject(path=directory_path_source)
string = StringInput("*.txt")  # graph input
getDirectoryContents = FileSystem.GetDirectoryContents(directory=directory_from_path, searchString=string)
fromPath = FileObject(path=getDirectoryContents.files)  # "File.FromPath"

byPath = Custom[Journal.ByPath](path=getDirectoryContents.files)  # Creates a queryable object from the contents of a Revit journal file

# group: Pull relevant meta data
revitBranch = Custom[Journal.RevitBranch](journal=byPath)
revitBuild = Custom[Journal.RevitBuild](journal=byPath)
revitVersion = Custom[Journal.RevitVersion](journal=byPath)
startupTime = Custom[Journal.StartupTime](journal=byPath)
sessionTerminatedProperly = Custom[Journal.SessionTerminatedProperly](journal=byPath)
sessionTime = Custom[Journal.SessionTime](journal=byPath)
processingTime = Custom[Journal.ProcessingTime](journal=byPath)
user = Custom[Journal.User](journal=byPath)
isInPlaybackMode = Custom[Journal.IsInPlaybackMode](journal=byPath)
playbackInterrupted = Custom[Journal.PlaybackInterrupted](journal=byPath)
OSVersion = Custom[Journal.OSVersion](journal=byPath)
minVMAvailable = Custom[Journal.MinVMAvailable](journal=byPath)
minRAMAvailable = Custom[Journal.MinRAMAvailable](journal=byPath)
maxVMPeak = Custom[Journal.MaxVMPeak](journal=byPath)
maxRAMPeak = Custom[Journal.MaxRAMPeak](journal=byPath)
machine = Custom[Journal.Machine](journal=byPath)
containsExceptions = Custom[Journal.ContainsExceptions](journal=byPath)
containsAPIErrors = Custom[Journal.ContainsAPIErrors](journal=byPath)
size = Custom[File.Size](file=fromPath)  # Returns the file size of a given file.
create = List.Create(item0=getDirectoryContents.files, item1=revitBranch, item2=revitBuild, item3=revitVersion, item4=startupTime, item5=sessionTerminatedProperly, item6=sessionTime, item7=processingTime, item8=user, item9=isInPlaybackMode, item10=playbackInterrupted, item11=OSVersion, item12=minVMAvailable, item13=minRAMAvailable, item14=maxVMPeak, item15=maxRAMPeak, item16=machine, item17=containsExceptions, item18=containsAPIErrors, item19=size.megabytes)

# group: Process data for export
string_2 = StringInput("")  # graph input
replaceNulls = Lists.Manage.ReplaceNulls(Data=create, ReplaceWith=string_2)
type = Object.Type(obj=replaceNulls)
code_block = CodeBlock(obj=type) { obj == "System.String"; }
string_from_object = FromObject(obj=replaceNulls)
if_ = If(test=code_block, true=replaceNulls, false=string_from_object)

# group: Create headings and add data
string_3 = StringInput("""JournalPath
RevitBranch
RevitBuild
RevitVersion
StartupTime
SessionTerminatedProperly
SessionTime
ProcessingTime
User
IsInPlaybackMode
PlaybackInterrupted
OSVersion
MinVMAvailable
MinRAMAvailable
MaxVMPeak
MaxRAMPeak
Machine
ContainsExceptions
ContainsAPIErrors
FileSize""")  # graph input
string_4 = StringInput("\n")  # graph input
split = String.Split(str=string_3, separater0=string_4)
create_2 = List.Create(item0=split)
transpose = List.Transpose(lists=if_)
join = List.Join(list0=create_2, list1=transpose)

# group: Write to Excel
combinePath = FileSystem.CombinePath(path0=directory_path_target, path1=filename_sheetname)
code_block_2 = CodeBlock(filename=combinePath) { filename + ".xlsx"; }
code_block_3 = CodeBlock { 0; }
boolean = BoolSelector(true)  # graph input
exportExcel = Data.ExportExcel(filePath=code_block_2, sheetName=filename_sheetname, startRow=code_block_3, startCol=code_block_3, data=join, overWrite=boolean)
