# Dynamo graph AllKeyboardShortcutsNodes.dyn (Dynamo 1.3.1.1736)

# group: INPUT
# note: QUESTION:
# Does the graph execute okay? Do any nodes turn yellow?
keyboardshortcuts_file_path = Filename("C:\Users\adieckmann\Desktop\KeyboardShortcuts.xml")

# group: KeyboardShortcuts.Create
fromPath = FileObject(keyboardshortcuts_file_path)  # "File.FromPath"; frozen
readText = File.ReadText(fromPath)
byString = Custom[KeyboardShortcuts.ByString](str=readText)  # Creates a queriable object from the content of a Revit KeyboardShortcuts.xml file

# group: KeyboardShortcuts.Query
commands = Custom[KeyboardShortcuts.Commands](keyboardShortcuts=byString)  # Returns all commands from a given KeyboardShirtcuts object
commandCountWithShortcuts = Custom[KeyboardShortcuts.CommandCountWithShortcuts](keyboardShortcuts=byString)  # Returns the total number of commands that have a shortcut assigned in a given KeyboardShirtcuts object
commandCount = Custom[KeyboardShortcuts.CommandCount](keyboardShortcuts=byString)  # Returns the total number of commands in a given KeyboardShirtcuts object
commandsWithShortcuts = Custom[KeyboardShortcuts.CommandsWithShortcuts](keyboardShortcuts=byString)  # Returns all commands that have a shortcut assigned from a given KeyboardShirtcuts object

# group: KeyboardShortcutCommand.Query
hasPaths = Custom[KeyboardShortcutCommand.HasPaths](keyboardShortcutCommand=commands)  # Returns whether a given command has any paths assigned
hasShortcuts = Custom[KeyboardShortcutCommand.HasShortcuts](keyboardShortcutCommand=commands)  # Returns whether a given command has any shortcuts assigned
ID = Custom[KeyboardShortcutCommand.ID](keyboardShortcutCommand=commands)  # Returns the ID of a given command
name = Custom[KeyboardShortcutCommand.Name](keyboardShortcutCommand=commands)  # Returns the name of a given command
paths = Custom[KeyboardShortcutCommand.Paths](keyboardShortcutCommand=commands)  # Returns all paths assigned to a given command
shortcuts = Custom[KeyboardShortcutCommand.Shortcuts](keyboardShortcutCommand=commands)  # Returns all shortcuts assigned to a given command

# group: Paths
allKeyboardShortcutFiles = Custom[Paths.AllKeyboardShortcutFiles]()  # Retrieves a list of all journal folders on the current machine
watch = Watch(allKeyboardShortcutFiles)
string = StringInput("2017")
keyboardShortcutsFileByVersion = Custom[Paths.KeyboardShortcutsFileByVersion](revitVersion=string)  # Retrieves the path of the keyboard shortcuts file for a given Revit version.
watch_2 = Watch(keyboardShortcutsFileByVersion)
