# Dynamo graph PythonExamples.dyn (Dynamo 1.3.1.1736)

# group: INPUT
file_path = Filename("..\..\..\Desktop\journals\journal.0855.txt")

# group: Evaluate Journal
fromPath = FileObject(file_path)  # "File.FromPath"
readText = File.ReadText(fromPath)
byString = Custom[Journal.ByString](str=readText)

# group: Python Examples
# note: Extract unique list of API error messages
python_script = Python(IN[0]=byString)
# ---------- python_script.python (6 lines) ----------
import clr

OUT = []
if IN[0].__repr__() == 'Journal':
	allAPImsgs = IN[0].GetLinesByType('JournalAPIMessage')
	OUT = set([x.MessageText for x in allAPImsgs if x.MessageType == 'Error'])
# ----------------------------------------
watch = Watch(python_script)
# note: Extract unique list of commands triggered by a keyboard shortcut
python_script_2 = Python(IN[0]=byString)
# ---------- python_script_2.python (6 lines) ----------
import clr

OUT = []
if IN[0].__repr__() == 'Journal':
	allJCommands = IN[0].GetLinesByType('JournalCommand')
	OUT = set([x.CommandID for x in allJCommands if x.CommandType == 'KeyboardShortcut'])
# ----------------------------------------
watch_2 = Watch(python_script_2)
# note: When was a model closed during the session?
python_script_3 = Python(IN[0]=byString)
# ---------- python_script_3.python (12 lines) ----------
import clr

OUT = []
files = []
ts = []
if IN[0].__repr__() == 'Journal':
	allUIEvents = IN[0].GetLinesByType('JournalUIEvent')
	closingEvents = [x for x in allUIEvents if x.UIEventType == 'Close']
	for event in closingEvents:
		files.append(event.Data[0][1:-1])
		ts.append(IN[0].GetLinesByBlock(event.Block)[0].DateTime)
OUT = (files,ts)
# ----------------------------------------
watch_3 = Watch(python_script_3)
