# Dynamo graph WorksharingLog_AllSessions.dyn (Dynamo 1.3.1.1736)

# group: INPUT
directory_path = Directory("C:\temp")
worksharing_log_file_path = Filename("..\..\..\Journals\Projekt1.slog")
filename = StringInput("WorksharingSessions")

# group: Process file
fromPath = FileObject(worksharing_log_file_path)  # "File.FromPath"
readText = File.ReadText(fromPath)
byString = Custom[WorksharingLog.ByString](str=readText)  # Creates a queriable object from a Revit worksharing log
sessions = Custom[WorksharingLog.Sessions](worksharingLog=byString)  # Returns all sessions of a given WorksharingLog

# group: Collect data
ID = Custom[WorksharingSession.ID](worksharingSession=sessions)  # Returns the ID of a given WorksharingSession
start = Custom[WorksharingSession.Start](worksharingSession=sessions)  # Returns the date and time a given WorksharingSession was started
user = Custom[WorksharingSession.User](worksharingSession=sessions)  # Returns the Revit user name of a given WorksharingSession
usesCentralModel = Custom[WorksharingSession.UsesCentralModel](worksharingSession=sessions)  # Determines if the user was working in the central model (as opposed to a local copy) in a given WorksharingSession
createsNewCentral = Custom[WorksharingSession.CreatesNewCentral](worksharingSession=sessions)  # Determines if a new central model was created in a given WorksharingSession
wasTerminatedProperly = Custom[WorksharingSession.WasTerminatedProperly](worksharingSession=sessions)  # Determines whether a given WorksharingSession was terminated properly
loadDuration = Custom[WorksharingSession.LoadDuration](worksharingSession=sessions)  # Computes the load time of the model (and all linked models) for a given WorksharingSession
totalSeconds = TimeSpan.TotalSeconds(loadDuration)
string = StringInput("")
replaceNull = Custom[List.ReplaceNull](seq=totalSeconds, replacement=string)  # Replaces all null values within a given list with a substitute
syncEvents = Custom[WorksharingSession.SyncEvents](worksharingSession=sessions)  # Extracts all SyncEvents from a given WorkharingSession
count = List.Count(syncEvents@L2)
hostName = Custom[WorksharingSession.HostName](worksharingSession=sessions)  # Returns the host name of a given WorksharingSession
create = List.Create(ID, start, user, usesCentralModel, createsNewCentral, wasTerminatedProperly, replaceNull, count, hostName)

# group: Export to Excel
central = Custom[WorksharingSession.Central](worksharingSession=sessions)  # Returns the file path to the central model of a given WorksharingSession
firstItem = List.FirstItem(central)
boolean = BoolSelector(false)
fileName = FilePath.FileName(firstItem, boolean)
code_block = CodeBlock(model=fileName, filename=filename) { model + "__" + filename + ".xlsx"; }
combine = FilePath.Combine(directory_path, code_block)
string_2 = StringInput("Sessions")
code_block_2 = CodeBlock { 0; }
string_3 = StringInput("""SessionID
SessionStarted
Username
WorkingInCentral
CreatingNewCentral
SessionTerminatedProperly
LoadDuration
NumberOfSyncs
Machine""")
string_4 = StringInput("\n")
split = String.Split(string_3, string_4)
create_2 = List.Create(split)
transpose = List.Transpose(create)
join = List.Join(create_2, transpose)
boolean_2 = BoolSelector(true)
writeToFile = Excel.WriteToFile(filePath=combine, sheetName=string_2, startRow=code_block_2, startCol=code_block_2, data=join, overWrite=boolean_2)
